# Dynamo graph BatchUpgrade-MonkeyJobNodes.dyn "BatchUpgrade2" (Dynamo 2.0.2.6826)

directory_path = Directory("C:\Users\car11899\Desktop\Entourage CTA")
python_script = Python(IN[0]=directory_path)
# ---------- python_script.python (35 lines) ----------
# Enable Python support and load DesignScript library
import sys 
import clr
import System
from System import Array
from System.Collections.Generic import *
clr.AddReference('ProtoGeometry')
from Autodesk.DesignScript.Geometry import *

clr.AddReference("RevitNodes") # Import RevitNodes

clr.AddReference("RevitServices")
import RevitServices
from RevitServices.Persistence import DocumentManager
from RevitServices.Transactions import TransactionManager

clr.AddReference('RevitAPI') #import clr
from Autodesk.Revit.DB import * 

pyt_path = r'C:\Program Files (x86)\IronPython 2.7\Lib'
sys.path.append(pyt_path)

import os
from os import path
import glob

path = IN[0]
files = []

for root, dirnames, filenames in os.walk(path):
	temp = [file for file in glob.glob(root + "**/*.rvt")]
	if temp != []:
		files.append(temp)
		
OUT = files		
# ----------------------------------------
flatten = List.Flatten(list=python_script)
extractSolids = JoaosCustomNodes.ExtractSolids.ExtractSolids()
code_block = CodeBlock { false; true; false; }
openDocumentFile = JoaosCustomNodes.ExtractSolids.OpenDocumentFile(extractSolids=extractSolids, filePath=flatten, audit=code_block.out0, detachFromCentral=code_block.out1, deleteLinks=code_block.out2)
python_script_2 = Python(IN[0]=flatten, IN[1]=openDocumentFile, IN[2]=directory_path)
# ---------- python_script_2.python (24 lines) ----------
# Enable Python support and load DesignScript library
import clr
clr.AddReference('ProtoGeometry')
from Autodesk.DesignScript.Geometry import *

# The inputs to this node will be stored as a list in the IN variables.
dataEnteringNode = IN

filePath = IN[0]

result = IN[1]

originalDirectory = IN[2]

OUT = []

for i, x in enumerate(filePath):
	tempString = str(x) + "|" + result[i] + "\n"
	OUT.append(tempString)
# Place your code below this line

txtLog = open(str(originalDirectory)+"\BatchUpgradeLog.txt", "w+")
txtLog.writelines(OUT)
txtLog.close()
# ----------------------------------------
watch = Watch(python_script_2)
code_block_2 = CodeBlock { 0..1; }
getItemAtIndex = List.GetItemAtIndex(list=flatten, index=code_block_2)
