# Dynamo graph FilterConcreteElements.dyn (Dynamo 2.2.1.5175)

isolate_in_view = Custom[Isolate in View]()  # This node will take input of elements and a view to isolate selected elements in a view.; unwired: element, view
watch = Watch(isolate_in_view)

# group: Find Materials with keyword as part of Structural Material
docOperations = MonkeyJobNodes.DocOperations.DocOperations()
docOperationsNeeds = MonkeyJobNodes.DocOperations.docOperationsNeeds(docOperations=docOperations)

getAllElementsID = MonkeyJobNodes.Miscellaneous.getAllElementsID(currentDocument=docOperationsNeeds.CurrentDocument)
byElementId = archilab.Revit.Selection.Select.ByElementId(id=getAllElementsID)
type = archilab.Revit.Elements.Elements.Type(element=byElementId)
isNull = Object.IsNull(obj=type)
filterByBoolMask = List.FilterByBoolMask(list=byElementId, mask=isNull)
code_block = CodeBlock { false; }
getMaterials = Element.GetMaterials(element=filterByBoolMask.out, paintMaterials=code_block)
python_script = Python(IN[0]=getMaterials)
# ---------- python_script.python (16 lines) ----------
# Load the Python Standard and DesignScript Libraries
import sys
import clr
clr.AddReference('ProtoGeometry')
from Autodesk.DesignScript.Geometry import *

lists = IN[0]

OUT = []

for list in lists:
	if len(list) > 0:
		OUT.append(True)
	else:
		OUT.append(False)
	#OUT.append(list.GetType())
# ----------------------------------------
filterByBoolMask_2 = List.FilterByBoolMask(list=filterByBoolMask.out, mask=python_script)
boolean = BoolSelector(false)
getMaterials_2 = Element.GetMaterials(element=filterByBoolMask_2.in, paintMaterials=boolean)
name = Material.Name(material=getMaterials_2)
python_script_2 = Python(IN[0]=name)
# ---------- python_script_2.python (16 lines) ----------
# Load the Python Standard and DesignScript Libraries
import sys
import clr
clr.AddReference('ProtoGeometry')
from Autodesk.DesignScript.Geometry import *


lists = IN[0]
OUT = []

for list in lists:
	for x in list:
		if "concrete" in x or "Concrete" in x:
			OUT.append(True)
		else:
			OUT.append(False)
# ----------------------------------------
filterByBoolMask_3 = List.FilterByBoolMask(list=filterByBoolMask_2.in, mask=python_script_2)
color_palette = ColorPalette({R: 255, G: 69, B: 0, A: 255})
overrideColorInView = Element.OverrideColorInView(element=filterByBoolMask_3.in, color=color_palette)
