# Dynamo graph HideElementsInView-MonkeyJobNodes.dyn "HideElementsInView" (Dynamo 2.0.2.6826)

# group: 1 - Select all elements of the model
select_model_elements = DSModelElementsSelection()  # 3882 picked in the model

code_block = CodeBlock { "4D Schedule Code"; }
getParameterValueByName = Element.GetParameterValueByName(element=select_model_elements, parameterName=code_block)
isStringEmpty = MonkeyJobNodes.UnderDevelopment.isStringEmpty(stringCont=getParameterValueByName)
filterByBoolMask = List.FilterByBoolMask(list=select_model_elements, mask=isStringEmpty)

# group: 2 - Select the view to hide elements on view
views = Views(index=8)

boolean = BoolSelector(true)
hideElements = Custom[View.HideElements](Element=filterByBoolMask.out, View=views, RunIt=boolean)  # This node will hide elements in specified view.
watch = Watch(hideElements)
