# Dynamo graph MatchDataBasedOnLocation.dyn (Dynamo 2.0.3.8810)

select_model_elements = DSModelElementsSelection()  # 1785 picked in the model
convertToAPIElement = MonkeyJobNodes.DocOperations.ConvertToAPIElement(directShape=select_model_elements)
removeNulls = Lists.Manage.RemoveNulls(Data=convertToAPIElement.BoundingBox)
removeNulls_2 = Lists.Manage.RemoveNulls(Data=convertToAPIElement.RevitApiElement)
removeItemAtIndex = List.RemoveItemAtIndex(list=convertToAPIElement.ElementID, indices=removeNulls_2.Indices)
python_script = Python(IN[0]=removeItemAtIndex, IN[1]=convertToAPIElement.TempID)
# ---------- python_script.python (18 lines) ----------
# Enable Python support and load DesignScript library
import clr
clr.AddReference('ProtoGeometry')
from Autodesk.DesignScript.Geometry import *

# The inputs to this node will be stored as a list in the IN variables.
dataEnteringNode = IN

# Place your code below this line

Ids = IN[0]

Center = IN[1]

OUT = []
for i, x in enumerate(Ids):
	temp = str(Ids[i]) + "," + str(Center[i])
	OUT.append(temp)
# ----------------------------------------
watch = Watch(python_script)
removeNulls_3 = Lists.Manage.RemoveNulls(Data=convertToAPIElement.CenterBoundingBox)
python_script_2 = Python(IN[0]=removeNulls_3.Cleaned)
# ---------- python_script_2.python (18 lines) ----------
# Enable Python support and load DesignScript library
import clr
clr.AddReference('ProtoGeometry')
from Autodesk.DesignScript.Geometry import *

# The inputs to this node will be stored as a list in the IN variables.
dataEnteringNode = IN

# Place your code below this line
points = IN[0]

OUT = []

for point in points:
	temp = str(point).replace("(", "").replace(")","")
	temp = temp.replace(", ", "_")
	OUT.append(temp)
# Assign your output to the OUT variable.
# ----------------------------------------
watch_2 = Watch(python_script_2)
code_block = CodeBlock { "Null,Null"; }
getDataTableInfo = MonkeyJobNodes.DocOperations.GetDataTableInfo()  # unwired: dataTable
watch_3 = Watch(getDataTableInfo)
code_block_2 = CodeBlock { true; "Location"; }
code_block_3 = CodeBlock { "ElementID,Location"; }
generateDataTable = MonkeyJobNodes.DocOperations.GenerateDataTable(Data=python_script, Headers=code_block_3)  # unwired: primaryKey
generateDataTable_2 = MonkeyJobNodes.DocOperations.GenerateDataTable(Data=python_script, Headers=code_block_3)  # unwired: primaryKey
code_block_4 = CodeBlock { true; }
mergeDataTables = MonkeyJobNodes.DocOperations.MergeDataTables(table1=generateDataTable, table2=generateDataTable_2, preserveChanges=code_block_4)
file_path = Filename("No file selected.")
exportCSV = Data.ExportCSV(filePath=file_path, data=python_script)
