# Dynamo graph OverrideColorInView-MonkeyJobNodes.dyn "OverrideColorInView" (Dynamo 2.0.2.6826)

select_model_elements = DSModelElementsSelection()  # 3882 picked in the model
code_block = CodeBlock { "4D Schedule Code"; }
getParameterValueByName = Element.GetParameterValueByName(element=select_model_elements, parameterName=code_block)
isStringEmpty = MonkeyJobNodes.UnderDevelopment.isStringEmpty(stringCont=getParameterValueByName)
filterByBoolMask = List.FilterByBoolMask(list=select_model_elements, mask=isStringEmpty)
color_palette = ColorPalette({R: 0, G: 0, B: 255, A: 255})
overrideColorInView = Element.OverrideColorInView(element=filterByBoolMask.in, color=color_palette)
color_palette_2 = ColorPalette({R: 255, G: 0, B: 0, A: 255})
overrideColorInView_2 = Element.OverrideColorInView(element=filterByBoolMask.out, color=color_palette_2)
